# Grasshopper definition robots_draw_square.gh (Grasshopper 1.0.8)
# plug-ins: Robots

# ---- group: Square
pt = ConstructPoint(XCoordinate=0, YCoordinate=Slider(-1000, range=-5000..5000), ZCoordinate=Slider(2250, range=-5000..5000))
xz = XZPlane(Origin=pt)
rectangle = Rectangle(Plane=xz, XSize=Domain(-500, 500), YSize=Domain(-500, 500), Radius=0)  # -> Rectangle, Length
cp = ControlPoints(Curve=rectangle.Rectangle)  # -> Points, Weights, Knots

# ---- group: Circle
circle = CircleCNR(Center=pt, Normal=xz, Radius=Slider(480, range=0..10000))
divide = DivideCurve(Curve=circle, Count=Slider(22, range=0..100), Kinks=False)  # -> Points, Tangents, Parameters

# ---- group: Mortadella
list = RobotsLibrary({"Nagami Multimove", "Nagami IRB6700", "Nagami IRB4600", "Nagami IRB6640"}, selected="Nagami IRB6700", Type=0)
xy = XYPlane(Origin=Point(0, 0, 0))
rotate = Rotate(Geometry=xy, Angle=degrees(Slider(0, range=-180..180)), Plane=PlaneXY(0, 0, 0))  # -> Geometry, Transform
loadrobot = LoadRobotSystem(Name=list, Base=rotate.Geometry)

# ----
pl = PlaneNormal(Origin=divide.Points, ZAxis=Vector(0, -1323.70594, 0))
list_2 = FlagFields({"Shoulder": 1, "Elbow": 2, "Wrist": 4}, selected="Wrist")
list_3 = ValueList({"Joint", "Linear"}, selected="Linear")
panel = Panel("C:\Users\madel\Dropbox\ATONATON\Clients\33000 - Iaac Workshop\2025\gh_exports")
target = CreateTarget(Plane=pl, RobConf=list_2, Motion=list_3, External=[], IsCartesian=True)
program = CreateProgram(Name="DefaultProgram", RobotSystem=loadrobot, Targets=target, StepSize=1)  # -> Program, Code, Duration, Warnings, Errors
sim = ProgramSimulation(Program=program.Program, Time=0, Normalized=True)  # -> SystemMeshes, JointRotations, Plane, Index, Time, Program, Errors
saveprog = SaveProgram(Program=program.Program, Folder=panel)
panel_2 = Panel(program.Code)
bang = ExplodeTree(Data=panel_2)  # -> _0000, _0001
flatten = FlattenTree(Tree=bang._0001, Path="{0}")
lng = ListLength(List=flatten)
dom = ConstructDomain(DomainStart=0, DomainEnd=expr("x-3", lng))
subset = SubList(List=flatten, Domain=dom, Wrap=True)  # -> List, Index
panel_3 = Panel(subset.List)
